# Dynamo graph Convex Hull to Mesh.dyn (Dynamo 2.5.0.7155)
# packages: MeshToolkit 2.0.1

# group: Generate Random Points
code_block = CodeBlock { 0; 1; 10; }
# note: NOTE:
# You will need to install the "MeshToolkit" package to use this sample
integer_slider = IntegerSlider(189, range=0..1000 step 1)
randomList = Math.RandomList(amount=integer_slider)
randomList_2 = Math.RandomList(amount=integer_slider)
randomList_3 = Math.RandomList(amount=integer_slider)
list_create = List.Create(item0=randomList, item1=randomList_2, item2=randomList_3)
mapTo = Math.MapTo(rangeMin=code_block.out0, rangeMax=code_block.out1, inputValue=list_create, targetRangeMin=code_block.out0, targetRangeMax=code_block.out2)
code_block_2 = CodeBlock { 0; 1; 2; }
getItemAtIndex = List.GetItemAtIndex(list=mapTo, index=code_block_2.out0)
getItemAtIndex_2 = List.GetItemAtIndex(list=mapTo, index=code_block_2.out1)
getItemAtIndex_3 = List.GetItemAtIndex(list=mapTo, index=code_block_2.out2)
byCoordinates = Point.ByCoordinates(x=getItemAtIndex, y=getItemAtIndex_2, z=getItemAtIndex_3)

# group: SolidConvexHull
facesAsPointsAndIndices = SolidConvexHull.SolidConvexHull.FacesAsPointsAndIndices(points=byCoordinates)

# group: Preview Hull Vertices
code_block_3 = CodeBlock { 0.15; }
byCenterPointRadius = Sphere.ByCenterPointRadius(centerPoint=facesAsPointsAndIndices.Points, radius=code_block_3)
code_block_4 = CodeBlock { 255; 0; 255; }
byARGB = Color.ByARGB(a=code_block_4.out0, r=code_block_4.out1, g=code_block_4.out1, b=code_block_4.out2)
byGeometryColor = Modifiers.GeometryColor.ByGeometryColor(geometry=byCenterPointRadius, color=byARGB)

# group: Create MeshToolkit Mesh
byVerticesAndIndices = Autodesk.Dynamo.MeshToolkit.Mesh.ByVerticesAndIndices(vertices=facesAsPointsAndIndices.Points, indices=facesAsPointsAndIndices.Indices)

# group: Preview Mesh
code_block_5 = CodeBlock { 60; 128; }
byARGB_2 = Color.ByARGB(a=code_block_5.out0, r=code_block_5.out1, g=code_block_5.out1, b=code_block_5.out1)
byMeshColor = Autodesk.Dynamo.MeshToolkit.Display.MeshDisplay.ByMeshColor(mesh=byVerticesAndIndices, meshColoring=byARGB_2)
