# Dynamo graph Convex Hull to Solid.dyn (Dynamo 2.5.0.7155)

# group: Generate Random Points
code_block = CodeBlock { 0; 1; 10; }
integer_slider = IntegerSlider(189, range=0..1000 step 1)
randomList = Math.RandomList(amount=integer_slider)
randomList_2 = Math.RandomList(amount=integer_slider)
randomList_3 = Math.RandomList(amount=integer_slider)
list_create = List.Create(item0=randomList, item1=randomList_2, item2=randomList_3)
mapTo = Math.MapTo(rangeMin=code_block.out0, rangeMax=code_block.out1, inputValue=list_create, targetRangeMin=code_block.out0, targetRangeMax=code_block.out2)
code_block_2 = CodeBlock { 0; 1; 2; }
getItemAtIndex = List.GetItemAtIndex(list=mapTo, index=code_block_2.out0)
getItemAtIndex_2 = List.GetItemAtIndex(list=mapTo, index=code_block_2.out1)
getItemAtIndex_3 = List.GetItemAtIndex(list=mapTo, index=code_block_2.out2)
byCoordinates = Point.ByCoordinates(x=getItemAtIndex, y=getItemAtIndex_2, z=getItemAtIndex_3)

# group: SolidConvexHull
facesAsThreePoints = SolidConvexHull.SolidConvexHull.FacesAsThreePoints(points=byCoordinates)

# group: Create faces and join into solid
code_block_3 = CodeBlock { true; }
byPoints = PolyCurve.ByPoints(points=facesAsThreePoints, connectLastToFirst=code_block_3)
byPatch = Surface.ByPatch(closedCurve=byPoints)
byJoinedSurfaces = Solid.ByJoinedSurfaces(facesOfSolid=byPatch)

# group: Preview
code_block_4 = CodeBlock { 60; 255; 0; }
byARGB = Color.ByARGB(a=code_block_4.out0, r=code_block_4.out1, g=code_block_4.out2, b=code_block_4.out2)
byGeometryColor = Modifiers.GeometryColor.ByGeometryColor(geometry=byJoinedSurfaces, color=byARGB)
